test file "MIL_ECFC_Harness"
  coverage: Decision, MCDC, Condition

suite "新建测试套件 1"

  case "新建测试用例 1" [baseline]

suite "MIL_ECFC"

  case "TC01_OffBelowLo" [baseline]
    description: 温度<低阈值(85)：风扇关，无故障
    model EngineCoolingFanController, harness Harness_ECFC
    input "TC01_OffBelowLo.mat" (active)
    iterations:
      Iteration1: ExternalInput "TC01_OffBelowLo.mat"

  case "TC02_HoldOff_Deadband" [baseline]
    description: 温度 80->90 进入滞环区间：保持关
    model EngineCoolingFanController, harness Harness_ECFC
    input "TC02_HoldOff_Deadband.mat" (active)
    iterations:
      Iteration1: ExternalInput "TC02_HoldOff_Deadband.mat"

  case "TC03_OnAboveHi" [baseline]
    description: 温度 80->96 超过高阈值(95)：风扇开
    model EngineCoolingFanController, harness Harness_ECFC
    input "TC03_OnAboveHi.mat" (active)
    iterations:
      Iteration1: ExternalInput "TC03_OnAboveHi.mat"

  case "TC04_HoldOn_Deadband" [baseline]
    description: 温度 96->90 滞环区间：保持开
    model EngineCoolingFanController, harness Harness_ECFC
    input "TC04_HoldOn_Deadband.mat" (active)
    iterations:
      Iteration1: ExternalInput "TC04_HoldOn_Deadband.mat"

  case "TC05_ResetBelowLo" [baseline]
    description: 温度 96->84 低于低阈值：风扇关
    model EngineCoolingFanController, harness Harness_ECFC
    input "TC05_ResetBelowLo.mat" (active)
    iterations:
      Iteration1: ExternalInput "TC05_ResetBelowLo.mat"

  case "TC06_IgnOff_Gate" [baseline]
    description: 温度96但点火关闭：风扇指令为0；点火开后为80
    model EngineCoolingFanController, harness Harness_ECFC
    input "TC06_IgnOff_Gate.mat" (active)
    iterations:
      Iteration1: ExternalInput "TC06_IgnOff_Gate.mat"

  case "TC07_Fault_HighTemp" [baseline]
    description: 温度115>110：故障=1，风扇开
    model EngineCoolingFanController, harness Harness_ECFC
    input "TC07_Fault_HighTemp.mat" (active)
    iterations:
      Iteration1: ExternalInput "TC07_Fault_HighTemp.mat"

  case "TC08_FaultRecovery" [baseline]
    description: 温度115->105：故障1->0，风扇仍开
    model EngineCoolingFanController, harness Harness_ECFC
    input "TC08_FaultRecovery.mat" (active)
    iterations:
      Iteration1: ExternalInput "TC08_FaultRecovery.mat"

  case "TC09_Boundary_Exact" [baseline]
    description: 温度恰为95/85：不触发置位/复位，保持关
    model EngineCoolingFanController, harness Harness_ECFC
    input "TC09_Boundary_Exact.mat" (active)
    iterations:
      Iteration1: ExternalInput "TC09_Boundary_Exact.mat"

  case "TC10_Hysteresis_Cycle" [baseline]
    description: 完整滞环周期 80->96->84->100：关->开->关->开
    model EngineCoolingFanController, harness Harness_ECFC
    input "TC10_Hysteresis_Cycle.mat" (active)
    iterations:
      Iteration1: ExternalInput "TC10_Hysteresis_Cycle.mat"