test file "MIL_ECFC_VNV"
  coverage: Decision, MCDC, Condition

suite "MIL_ECFC"

  case "TC01_OffBelowLo" [baseline]
    model EngineCoolingFanController, mode Normal, stop time 51
    input "TC01_OffBelowLo.mat" (active)
    iterations:
      Iteration1: ExternalInput "TC01_OffBelowLo.mat"

  case "TC02_HoldOff_Deadband" [baseline]
    model EngineCoolingFanController, mode Normal, stop time 51
    input "TC02_HoldOff_Deadband.mat" (active)
    iterations:
      Iteration1: ExternalInput "TC02_HoldOff_Deadband.mat"

  case "TC03_OnAboveHi" [baseline]
    model EngineCoolingFanController, mode Normal, stop time 51
    input "TC03_OnAboveHi.mat" (active)
    iterations:
      Iteration1: ExternalInput "TC03_OnAboveHi.mat"

  case "TC04_HoldOn_Deadband" [baseline]
    model EngineCoolingFanController, mode Normal, stop time 51
    input "TC04_HoldOn_Deadband.mat" (active)
    iterations:
      Iteration1: ExternalInput "TC04_HoldOn_Deadband.mat"

  case "TC05_ResetBelowLo" [baseline]
    model EngineCoolingFanController, mode Normal, stop time 51
    input "TC05_ResetBelowLo.mat" (active)
    iterations:
      Iteration1: ExternalInput "TC05_ResetBelowLo.mat"

  case "TC06_IgnOff_Gate" [baseline]
    model EngineCoolingFanController, mode Normal, stop time 51
    input "TC06_IgnOff_Gate.mat" (active)
    iterations:
      Iteration1: ExternalInput "TC06_IgnOff_Gate.mat"

  case "TC07_Fault_HighTemp" [baseline]
    model EngineCoolingFanController, mode Normal, stop time 51
    input "TC07_Fault_HighTemp.mat" (active)
    iterations:
      Iteration1: ExternalInput "TC07_Fault_HighTemp.mat"

  case "TC08_FaultRecovery" [baseline]
    model EngineCoolingFanController, mode Normal, stop time 51
    input "TC08_FaultRecovery.mat" (active)
    iterations:
      Iteration1: ExternalInput "TC08_FaultRecovery.mat"

  case "TC09_Boundary_Exact" [baseline]
    model EngineCoolingFanController, mode Normal, stop time 51
    input "TC09_Boundary_Exact.mat" (active)
    iterations:
      Iteration1: ExternalInput "TC09_Boundary_Exact.mat"

  case "TC10_Hysteresis_Cycle" [baseline]
    model EngineCoolingFanController, mode Normal, stop time 51
    input "TC10_Hysteresis_Cycle.mat" (active)
    iterations:
      Iteration1: ExternalInput "TC10_Hysteresis_Cycle.mat"

  case "MC11_SetHold_TruthTable" [baseline]
    model EngineCoolingFanController, mode Normal, stop time 51
    input "MC11_SetHold_TruthTable.mat" (active)
    iterations:
      Iteration1: ExternalInput "MC11_SetHold_TruthTable.mat"

  case "MC12_FanGate_TruthTable" [baseline]
    model EngineCoolingFanController, mode Normal, stop time 51
    input "MC12_FanGate_TruthTable.mat" (active)
    iterations:
      Iteration1: ExternalInput "MC12_FanGate_TruthTable.mat"

  case "MC13_Fault_TruthTable" [baseline]
    model EngineCoolingFanController, mode Normal, stop time 51
    input "MC13_Fault_TruthTable.mat" (active)
    iterations:
      Iteration1: ExternalInput "MC13_Fault_TruthTable.mat"